# Dynamo graph Conduit-Metadata-Propagator.dyn "Run_Name and SKU" (Dynamo 3.3.0.6316)

# group: Fetch all conduits and fittings
categories = Categories("OST_ConduitFitting")
all_elements_of_category = ElementsOfCategory(Category=categories)
watch = Watch(all_elements_of_category)
categories_2 = Categories("OST_Conduit")
all_elements_of_category_2 = ElementsOfCategory(Category=categories_2)
watch_2 = Watch(all_elements_of_category_2)

# group: Selecting only elbows from fittings
elementType = Element.ElementType(element=all_elements_of_category)
string = StringInput("Family Name")
getParameterValueByName = Element.GetParameterValueByName(element=elementType, parameterName=string)
watch_3 = Watch(getParameterValueByName)
string_2 = StringInput("elbow")
boolean = BoolSelector(true)
contains = String.Contains(string=getParameterValueByName, searchFor=string_2, ignoreCase=boolean)
filterByBoolMask = List.FilterByBoolMask(list=all_elements_of_category, mask=contains)
watch_4 = Watch(filterByBoolMask.in)

# group: Fittings with missing run name /sku
string_3 = StringInput("Run Name")
getParameterValueByName_2 = Element.GetParameterValueByName(element=filterByBoolMask.in, parameterName=string_3)
watch_5 = Watch(getParameterValueByName_2)
string_4 = StringInput("SKU")
getParameterValueByName_3 = Element.GetParameterValueByName(element=filterByBoolMask.in, parameterName=string_4)
watch_6 = Watch(getParameterValueByName_3)
string_5 = StringInput("")
eq = getParameterValueByName_3 == string_5
watch_7 = Watch(eq)
isNull = Object.IsNull(object=getParameterValueByName_2)
watch_8 = Watch(isNull)
isNull_2 = Object.IsNull(object=getParameterValueByName_3)
watch_9 = Watch(isNull_2)
string_6 = StringInput("")
eq_2 = getParameterValueByName_2 == string_6
watch_10 = Watch(eq_2)
or_ = Or(bool0=isNull, bool1=eq_2)
filterByBoolMask_2 = List.FilterByBoolMask(list=filterByBoolMask.in, mask=or_)
watch_11 = Watch(filterByBoolMask_2.in)
or_2 = Or(bool0=isNull_2, bool1=eq)
filterByBoolMask_3 = List.FilterByBoolMask(list=filterByBoolMask.in, mask=or_2)
watch_12 = Watch(filterByBoolMask_3.in)

# group: Conduits with missing run name / SKU
string_7 = StringInput("Run Name")
getParameterValueByName_4 = Element.GetParameterValueByName(element=all_elements_of_category_2, parameterName=string_7)
watch_13 = Watch(getParameterValueByName_4)
string_8 = StringInput("SKU")
getParameterValueByName_5 = Element.GetParameterValueByName(element=all_elements_of_category_2, parameterName=string_8)
watch_14 = Watch(getParameterValueByName_5)
isNull_3 = Object.IsNull(object=getParameterValueByName_4)
string_9 = StringInput("")
eq_3 = getParameterValueByName_4 == string_9
or_3 = Or(bool0=isNull_3, bool1=eq_3)
filterByBoolMask_4 = List.FilterByBoolMask(list=all_elements_of_category_2, mask=or_3)
isNull_4 = Object.IsNull(object=getParameterValueByName_5)
string_10 = StringInput("")
eq_4 = getParameterValueByName_5 == string_10
or_4 = Or(bool0=isNull_4, bool1=eq_4)
filterByBoolMask_5 = List.FilterByBoolMask(list=all_elements_of_category_2, mask=or_4)
watch_15 = Watch(filterByBoolMask_4.in)
watch_16 = Watch(filterByBoolMask_5.in)
watch_17 = Watch(eq_3)
watch_18 = Watch(eq_4)
watch_19 = Watch(isNull_3)

# group: Grouping bad fittings
s = List.Join(list0=filterByBoolMask_2.in, list1=filterByBoolMask_3.in)
watch_20 = Watch(s)

# group: Grouping good fittings
s_2 = List.Join(list0=filterByBoolMask_2.out, list1=filterByBoolMask_3.out)
watch_21 = Watch(s_2)

# group: Start/End Point good Bends
curves = Element.Curves(element=s_2)
watch_22 = Watch(curves)
python_script = Python(IN[0]=curves)  # IronPython2
# ---------- python_script.python (26 lines) ----------
import clr
clr.AddReference('ProtoGeometry')
from Autodesk.DesignScript.Geometry import *

curve_groups = IN[0]

flat_start_points = []
flat_end_points = []
paired_points = []

for group in curve_groups:
    if not group: continue
    for curve in group:
        if curve is None:
            continue
        try:
            sp = curve.StartPoint
            ep = curve.EndPoint
            flat_start_points.append(sp)
            flat_end_points.append(ep)
            paired_points.append([sp, ep])
        except:
            continue

# Combine results for single output port
OUT = [flat_start_points, flat_end_points, paired_points]
# ----------------------------------------
number = DoubleInput(0)
getItemAtIndex = List.GetItemAtIndex(list=python_script, index=number)
watch_23 = Watch(getItemAtIndex)
watch_24 = Watch(python_script)
watch_25 = Watch(python_script)
number_2 = DoubleInput(2)
getItemAtIndex_2 = List.GetItemAtIndex(list=python_script, index=number_2)
watch_26 = Watch(getItemAtIndex_2)
number_3 = DoubleInput(1)
getItemAtIndex_3 = List.GetItemAtIndex(list=python_script, index=number_3)
watch_27 = Watch(getItemAtIndex_3)

# group: Grouping good conduits
fittings_with_parameters = List.Join(list0=filterByBoolMask_4.out, list1=filterByBoolMask_5.out)
watch_28 = Watch(fittings_with_parameters)

# group: Start/End Point for goodConduits
getLocation = Element.GetLocation(element=fittings_with_parameters)
watch_29 = Watch(getLocation)
python_script_2 = Python(IN[0]=getLocation)  # IronPython2
# ---------- python_script_2.python (23 lines) ----------
import clr
clr.AddReference('ProtoGeometry')
from Autodesk.DesignScript.Geometry import *

elements = IN[0]

start_pts = []
end_pts = []
point_pairs = []

for line in elements:
    try:
        start = line.StartPoint
        end = line.EndPoint
        start_pts.append(start)
        end_pts.append(end)
        point_pairs.append([start, end])
    except:
        start_pts.append(None)
        end_pts.append(None)
        point_pairs.append([None, None])

OUT = start_pts, end_pts, point_pairs
# ----------------------------------------
watch_30 = Watch(python_script_2)
number_4 = DoubleInput(0)
getItemAtIndex_4 = List.GetItemAtIndex(list=python_script_2, index=number_4)
watch_31 = Watch(getItemAtIndex_4)
number_5 = DoubleInput(1)
getItemAtIndex_5 = List.GetItemAtIndex(list=python_script_2, index=number_5)
watch_32 = Watch(getItemAtIndex_5)
number_6 = DoubleInput(2)
getItemAtIndex_6 = List.GetItemAtIndex(list=python_script_2, index=number_6)
watch_33 = Watch(getItemAtIndex_6)

# group: Grouping bad conduits
fittings_with_parameters_2 = List.Join(list0=filterByBoolMask_4.in, list1=filterByBoolMask_5.in)
watch_34 = Watch(fittings_with_parameters_2)

# group: Start/End Point for Bad bends
curves_2 = Element.Curves(element=s)
watch_35 = Watch(curves_2)
python_script_3 = Python(IN[0]=curves_2)  # IronPython2
# ---------- python_script_3.python (36 lines) ----------
import clr
clr.AddReference('ProtoGeometry')
from Autodesk.DesignScript.Geometry import *
from itertools import combinations

curve_groups = IN[0]
results = []

for curves in curve_groups:
    points = []
    # Extract all endpoints from all curves
    for c in curves:
        try:
            points.append(c.StartPoint)
            points.append(c.EndPoint)
        except:
            continue

    # If less than 2 points, skip
    if len(points) < 2:
        results.append(None)
        continue

    # Find the pair of points with the maximum distance
    max_dist = 0
    best_pair = [points[0], points[1]]

    for a, b in combinations(points, 2):
        d = a.DistanceTo(b)
        if d > max_dist:
            max_dist = d
            best_pair = [a, b]

    results.append(best_pair)

OUT = results
# ----------------------------------------
watch_36 = Watch(python_script_3)

# group: Start end points for bad conduits
getLocation_2 = Element.GetLocation(element=fittings_with_parameters_2)
watch_37 = Watch(getLocation_2)
python_script_4 = Python(IN[0]=getLocation_2)  # IronPython2; same code as python_script_2
number_7 = DoubleInput(0)
getItemAtIndex_7 = List.GetItemAtIndex(list=python_script_4, index=number_7)
watch_38 = Watch(getItemAtIndex_7)
number_8 = DoubleInput(1)
getItemAtIndex_8 = List.GetItemAtIndex(list=python_script_4, index=number_8)
watch_39 = Watch(getItemAtIndex_8)
number_9 = DoubleInput(2)
getItemAtIndex_9 = List.GetItemAtIndex(list=python_script_4, index=number_9)
watch_40 = Watch(getItemAtIndex_9)
watch_41 = Watch(python_script_4)

# group: List of Bad Elements
list_create = List.Create(item0=s, item1=fittings_with_parameters_2)
flatten = List.Flatten(list=list_create)
watch_42 = Watch(flatten)

# group: List of Good Elements
list_create_2 = List.Create(item0=s_2, item1=fittings_with_parameters)
flatten_2 = List.Flatten(list=list_create_2)
watch_43 = Watch(flatten_2)

# group: Good Conduit w/ Points & Run Name
string_11 = StringInput("Run Name")
python_script_5 = Python(IN[0]=fittings_with_parameters, IN[1]=string_11)  # IronPython2
# ---------- python_script_5.python (27 lines) ----------
import clr
clr.AddReference('RevitAPI')
clr.AddReference('RevitServices')
from RevitServices.Persistence import DocumentManager
from Autodesk.Revit.DB import *

doc = DocumentManager.Instance.CurrentDBDocument
elements = UnwrapElement(IN[0])
param_name = IN[1] if len(IN) > 1 and IN[1] else "Run Name"

results = []

for e in elements:
    loc = e.Location
    run_param = e.LookupParameter(param_name)
    run_val = run_param.AsString() if run_param else None

    if isinstance(loc, LocationCurve):
        curve = loc.Curve
        start = curve.GetEndPoint(0)
        end = curve.GetEndPoint(1)
        data = ["Conduit", e.Id.IntegerValue, [start, end], run_val]
        results.append(data)
    else:
        results.append(["Conduit", e.Id.IntegerValue, ["NoCurve", "NoCurve"], run_val])

OUT = results
# ----------------------------------------
watch_44 = Watch(python_script_5)

# group: Bad Conduit w/ Points & Run Name
string_12 = StringInput("Run Name")
python_script_6 = Python(IN[0]=fittings_with_parameters_2, IN[1]=string_12)  # IronPython2; same code as python_script_5
watch_45 = Watch(python_script_6)

# group: Bad Fittings w/ Point & Run Name
curves_3 = Element.Curves(element=s)
python_script_7 = Python(IN[0]=curves_3, IN[1]=s)  # IronPython2
# ---------- python_script_7.python (38 lines) ----------
import clr
clr.AddReference('ProtoGeometry')
clr.AddReference('RevitAPI')
clr.AddReference('RevitServices')
from Autodesk.DesignScript.Geometry import *
from RevitServices.Persistence import DocumentManager
from Autodesk.Revit.DB import *

doc = DocumentManager.Instance.CurrentDBDocument

curve_groups = IN[0]
elements = IN[1]  # matching Revit elements
param_name = IN[2] if len(IN) > 2 and IN[2] else "Run Name"

output = []

for i in range(len(curve_groups)):
    group = curve_groups[i]
    element = elements[i]
    
    if not group:
        continue
    
    revit_elem = UnwrapElement(element)
    run_param = revit_elem.LookupParameter(param_name)
    run_val = run_param.AsString() if run_param else None

    for curve in group:
        if curve is None:
            continue
        try:
            sp = curve.StartPoint
            ep = curve.EndPoint
            output.append(["Fitting", revit_elem.Id.IntegerValue, [sp, ep], run_val])
        except:
            continue

OUT = output
# ----------------------------------------
watch_46 = Watch(python_script_7)

# group: Good Fittings w/ Point & Run Name
curves_4 = Element.Curves(element=s_2)
string_13 = StringInput("Run Name")
python_script_8 = Python(IN[0]=curves_4, IN[1]=s_2, IN[2]=string_13)  # IronPython2; same code as python_script_7
watch_47 = Watch(python_script_8)

# group: Matching by Point 2 Point and Chaining Inference
number_10 = DoubleInput(0.125)
python_script_9 = Python(IN[0]=python_script_8, IN[1]=python_script_5, IN[2]=python_script_7, IN[3]=python_script_6, IN[4]=number_10)  # CPython3
# ---------- python_script_9.python (83 lines) ----------
import clr
clr.AddReference('RevitAPI')
from Autodesk.Revit.DB import XYZ
from collections import defaultdict, deque

# --- Helpers ---
def to_XYZ(p):
    """Convert point to Revit XYZ object."""
    return XYZ(p.X, p.Y, p.Z)

def point_key(p, tol):
    """Return a tuple representing the point rounded by tolerance."""
    return (round(p.X / tol), round(p.Y / tol), round(p.Z / tol))

# --- Inputs ---
good_fittings = IN[0] or []
good_conduits = IN[1] or []
bad_fittings = IN[2] or []
bad_conduits = IN[3] or []
tol = IN[4] if IN[4] else 1.0 / 96  # Default to 1/8 inch

# --- Step 1: Combine all elements ---
all_elements = good_fittings + good_conduits + bad_fittings + bad_conduits
element_lookup = {e[1]: e for e in all_elements}  # Keyed by element ID

# --- Step 2: Build point-to-element map ---
point_map = defaultdict(set)
for e in all_elements:
    for pt in e[2]:  # Start and end points
        point_map[point_key(to_XYZ(pt), tol)].add(e[1])

# --- Step 3: Build graph of connected elements ---
graph = defaultdict(set)
for ids in point_map.values():
    ids = list(ids)
    for i in range(len(ids)):
        for j in range(i + 1, len(ids)):
            a, b = ids[i], ids[j]
            graph[a].add(b)
            graph[b].add(a)

# --- Step 4: Index known metadata ---
good_ids = set(e[1] for e in good_fittings + good_conduits)
metadata = {e[1]: e for e in good_fittings + good_conduits}

# --- Step 5: Resolve bad elements by graph search ---
resolved = []
bad_elements = bad_fittings + bad_conduits

for bad in bad_elements:
    b_type, b_id, b_pts, b_run = bad
    visited = set()
    queue = deque([(b_id, 0)])  # Start BFS
    found = None

    while queue:
        current, depth = queue.popleft()
        if current in visited:
            continue
        visited.add(current)

        if current in good_ids:
            found = metadata[current]
            break

        for neighbor in graph.get(current, []):
            if neighbor not in visited:
                queue.append((neighbor, depth + 1))

    if found:
        resolved.append([
            b_type, b_id, b_pts, b_run,  # Bad element info
            found[0], found[1], found[2], found[3],  # Good metadata
            depth  # Hop count
        ])
    else:
        resolved.append([
            b_type, b_id, b_pts, b_run,
            "NoMatch", None, None, None, None
        ])

# --- Output ---
OUT = resolved
# ----------------------------------------
python_script_10 = Python(IN[0]=python_script_9)  # IronPython2
# ---------- python_script_10.python (3 lines) ----------
# IN[0] = resolved list
fitting_mask = [x[0] == "Fitting" for x in IN[0]]
OUT = fitting_mask
# ----------------------------------------
watch_48 = Watch(python_script_10)
filterByBoolMask_6 = List.FilterByBoolMask(list=python_script_9, mask=watch_48)
watch_49 = Watch(python_script_9)
watch_50 = Watch(filterByBoolMask_6.in)
watch_51 = Watch(filterByBoolMask_6.out)

# group: Write the Parameter into bad elements
string_14 = StringInput("Run Name")
string_15 = StringInput("SKU")
python_script_11 = Python(IN[0]=filterByBoolMask_6.in, IN[1]=filterByBoolMask_6.out, IN[2]=string_14, IN[3]=string_15)  # IronPython2
# ---------- python_script_11.python (93 lines) ----------
import clr
clr.AddReference('RevitAPI')
clr.AddReference('RevitServices')
from Autodesk.Revit.DB import *
from RevitServices.Persistence import DocumentManager
from RevitServices.Transactions import TransactionManager

doc = DocumentManager.Instance.CurrentDBDocument

matched_fittings = IN[0]
matched_conduits = IN[1]
param_run = IN[2]
param_sku = IN[3]

set_count = 0
fail_count = 0
log = []

TransactionManager.Instance.EnsureInTransaction(doc)

def should_write_sku(elem):
    try:
        phase_param = elem.LookupParameter("Phase Created")
        if phase_param and phase_param.AsString() == "Field Construction":
            return False
    except:
        pass
    return True

def set_params(bad_type, bad_id, good_id, run_param, sku_param):
    global set_count, fail_count, log
    try:
        bad_elem = doc.GetElement(ElementId(bad_id))
        good_elem = doc.GetElement(ElementId(good_id))

        # Always write Run Name
        run_p = good_elem.LookupParameter(run_param)
        tgt_run = bad_elem.LookupParameter(run_param)
        label = "{} {} - {}".format(bad_type, bad_id, run_param)

        if run_p and tgt_run:
            val = run_p.AsString() if run_p.StorageType == StorageType.String else run_p.AsValueString()
            if val:
                tgt_run.Set(val)
                set_count += 1
                log.append(label + " set")
            else:
                log.append(label + " failed (no value)")
                fail_count += 1
        else:
            log.append(label + " failed (param missing)")
            fail_count += 1

        # Conditionally write SKU
        if should_write_sku(bad_elem):
            sku_p = good_elem.LookupParameter(sku_param)
            tgt_sku = bad_elem.LookupParameter(sku_param)
            label = "{} {} - {}".format(bad_type, bad_id, sku_param)

            if sku_p and tgt_sku:
                val = sku_p.AsString() if sku_p.StorageType == StorageType.String else sku_p.AsValueString()
                if val:
                    tgt_sku.Set(val)
                    set_count += 1
                    log.append(label + " set")
                else:
                    log.append(label + " failed (no value)")
                    fail_count += 1
            else:
                log.append(label + " failed (param missing)")
                fail_count += 1
        else:
            log.append("{} {} - SKU skipped (Field Construction)".format(bad_type, bad_id))

    except:
        log.append("{} {} - general error".format(bad_type, bad_id))
        fail_count += 1

# Write Fittings
for entry in matched_fittings:
    bad_type, bad_id, _, _, good_type, good_id, _, _, _ = entry
    if good_id:
        set_params(bad_type, bad_id, good_id, param_run, param_sku)

# Write Conduits
for entry in matched_conduits:
    bad_type, bad_id, _, _, good_type, good_id, _, _, _ = entry
    if good_id:
        set_params(bad_type, bad_id, good_id, param_run, param_sku)

TransactionManager.Instance.TransactionTaskDone()

OUT = ["Finished", "Set OK", set_count, "Failed", fail_count, log]
# ----------------------------------------
watch_52 = Watch(python_script_11)
